# Grasshopper definition rhino_command_convert_to_assembly.gh (Grasshopper 1.0.7)
# plug-ins: NGon, Kangaroo2 Components

panel = Panel("""1.7771787405000474
-2.101508956288849
-0.125
4.222821259499953
-2.101508956288849
-0.125
4.222821259499953
2.101508956288849
-0.125
1.7771787405000474
2.101508956288849
-0.125
1.7771787405000474
-2.101508956288849
0.125
4.222821259499953
-2.101508956288849
0.125
4.222821259499953
2.101508956288849
0.125
1.7771787405000474
2.101508956288849
0.125""")
geo = Geometry(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)
B = Brep(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)
bbox = BoundingBox(Content=[B, geo], Plane=PlaneXY(0, 0, 0), UnionBox=True)  # -> Box, Box_2
pt = Point([Point(29.86112709, 86.30366987, -0.499998692), Point(17.86112709, 86.30366987, -0.499998692), Point(17.86112709, 98.30366987, -0.499998692), Point(29.86112709, 98.30366987, -0.499998692), Point(20.26112709, 92.30366988, 0.7253646368), Point(23.8611271, 95.90366987, 0.7253646368), Point(27.46112709, 92.30366987, 0.7253646368), Point(23.86112708, 88.70366987, 0.7253646368), Point(23.86112709, 92.30366987, 0.9737631672)])
pt_2 = Point([Point(23.86112733, 86.30366987, 0.250000654), Point(29.86112733, 86.30366987, 0.250000654), Point(29.86112757, 92.30367162, 0.25), Point(23.8611272, 92.30367162, 0.250000654), Point(24.550148, 90.07399703, 0.7497863423), Point(24.550148, 88.53334446, 0.7497864421), Point(26.0908011, 86.99269136, 0.7497862939), Point(27.63145367, 86.99269136, 0.7497861102), Point(29.17210677, 88.53334446, 0.7497859153), Point(29.17210677, 90.07399703, 0.7497858154), Point(27.63145367, 91.61465013, 0.7497859637), Point(26.0908011, 91.61465013, 0.7497861473), Point(26.86112733, 89.30366987, 0.8557861025)])
area = Area(Geometry=bbox.Box)  # -> Area, Centroid
brep_cp = BrepClosestPoint(Point=pt_2, Brep=B)  # -> Point, Normal, Distance
scale_nu = ScaleNU(Geometry=bbox.Box, Plane=area.Centroid, ScaleX=1, ScaleY=1, ScaleZ=2)  # -> Geometry, Transform
partition = PartitionList(List=panel, Size=Slider(3, range=0..10))
voronoi³ = Voronoi3D(Points=brep_cp.Point, Box=scale_nu.Geometry)  # -> Cells, Boundary
brep = Brep(<brep referenced from the Rhino model>)
bbx = BrepBrep(BrepA=B, BrepB=voronoi³.Cells)  # -> simplify(Curves), Points
num2pt = NumbersToPoints(Numbers=partition, Mask=4)
disc = Discontinuity(Curve=bbx.Curves, Level=1)  # -> Points, Parameters
hexdivide = HexDivide(
    Surface=brep,
    U=Slider(4, range=0..10),
    V=Slider(2, range=0..10),
    Parameter=Slider(0.42, range=0..1),
    Boundary=0,
    Swap=invert(True),
    Rebuild=-1,
    Quadrangulate=False,
    Divisions=True,
    Explode=False)  # -> Mesh, DistA, DistB
qsph = QuadSphere(Base=PlaneXY(0, 0, 0), Radius=1)
panel_2 = Panel("""0
1
2
3""")
disc_2 = Discontinuity(Curve=bbx.Curves, Level=1)  # -> Points, Parameters
duppt = RemoveDuplicatePts(Points=flatten(disc.Points), Tolerance=0.01)
conmesh = ConstructMesh(Vertices=flatten(num2pt), Faces={A=0, B=1, C=2, D=3})
cp = ClosestPoint(Point=disc_2.Points, Cloud=duppt)  # -> ClosestPoint, CPIndex, Distance
pline = PolyLine(Vertices=cp.ClosestPoint, Closed=invert(False))
fromp = FromPolylines(Curves=flatten(pline), Min_Triangulation=True)
c_script = CSharpScript(mesh=fromp, Reference="C:\Users\petrasv\AppData\Roaming\McNeel\Rhinoceros\packages\7.0\NGon\3.2.0\NGonsCore.dll")  # -> out, plines; inputs mesh: Mesh
# ---------- c_script: C# usings ----------
using NGonsCore;
# ---------- c_script: C# ----------
    var dtLines = new DataTree<Line>();
    Polyline[] plines = PlanarizeNeighbourFaces.Run(mesh, ref dtLines);
    _plines = plines;
# ---------- c_script: C# additional code ----------
  public static  class PlanarizeNeighbourFaces {

    public  static Polyline[]  Run (Mesh M, ref DataTree<Line> dt_, bool naked_as_zaxis = true) {

      Plane[] planes = M.GetNgonPlanes();
      Polyline[] plines = M._Polylines();


      //Instead of doing   per face do edges first.

      Dictionary<int, int[]> efDict = M._EFDict();
      Line[] efLines = new Line[efDict.Count];
      Line[] efLinesOriginal = new Line[efDict.Count];
      Dictionary<int, Line> efLinesDict = new Dictionary<int, Line>();
      double[] angles = new double[efDict.Count];
      var dt = new DataTree<Line>();

      var debugPlanes0 = new List<Plane>();
      var debugPlanes1 = new List<Plane>();

      int counter = 0;
      foreach (var pair in efDict) {

        int meshE = pair.Key;
        Line line = M.TopologyEdges.EdgeLine(meshE);
        Point3d mid = line.PointAt(0.5);
        int[] f = pair.Value;
        efLinesOriginal[counter] = line;

        Plane pl0 = planes[f[0]];
        Plane pl1 = Plane.Unset;




        //Normal - plane-plane intersection
        //  does not make sense
        if (f.Length == 2) {

          Plane zPlane = new Plane(planes[f[0]].Origin, planes[f[0]].ZAxis, planes[f[1]].ZAxis);


          double angle = Vector3d.VectorAngle(planes[f[0]].ZAxis, planes[f[1]].ZAxis, zPlane);//
          debugPlanes0.Add(planes[f[0]]);
          debugPlanes1.Add(planes[f[1]]);
          angles[counter] = angle;

          pl1 = planes[f[1]];

        } else { //Naked - plane - edge planes
          angles[counter] = 0;
          Point3d p = mid;
          Vector3d dir = line.Direction;
              Rhino.RhinoDoc.ActiveDoc.Objects.AddLine(line); 

          pl1 = naked_as_zaxis ? new Plane(p, dir, Vector3d.ZAxis) : new Plane(p, dir, pl0.ZAxis);

        }

        //do   only if angle is small
        Line l = NGonsCore.PlaneUtil.PlanePlane(pl0, pl1);
//        NGonsCore.BakeUtil.Bake(pl0, 0.1);
//        NGonsCore.BakeUtil.Bake(pl1, 0.1);
//    

        //If coplanar use the same edges ???
        if (Math.Abs(angles[counter]) < 0.01 && f.Length == 2)  {

          l = line;
        }


        l.Transform(Transform.Scale(l.PointAt(0.5), 1 / l.Length));
        efLines[counter++] = l;
        efLinesDict.Add(meshE, l);
      }



      Polyline[] plinesPlanar = new Polyline[plines.Length];
      Line[][] faceLines = new Line[plines.Length][];
      Line[][] faceLinesO = new Line[plines.Length][];

      for (int i = 0; i < M.Ngons.Count; i++) {

        int[] fe = M._fe(i);

        Line[] lnToIntersect = new Line[fe.Length];
        for (int j = 0; j < fe.Length; j++) {
          lnToIntersect[j] = efLinesDict[fe[j]];
        }


        faceLines[i] = lnToIntersect;


        //Display
        //dtLines.AddRange(lnToIntersect, new GH_Path(i));
        //dtPlanes.Add(planes[i], new GH_Path(i));
        dt.AddRange(lnToIntersect, new Grasshopper.Kernel.Data.GH_Path(i));
      }

      for (int i = 0; i < M.Ngons.Count; i++) {

        int[] fe = M._fe(i);
        faceLinesO[i] = new Line[fe.Length];



        for (int j = 0; j < fe.Length; j++) {
          int[] feo = M._OppositeFE(i, j, -1);

          if (feo[0] != -1) {
            faceLinesO[i][j] = faceLines[feo[0]][feo[1]];
          } else {
            faceLinesO[i][j] = faceLines[i].next(j);
          }

        }
      }

      for (int i = 0; i < M.Ngons.Count; i++) {
        plinesPlanar[i] = IntersectLines(faceLines[i], faceLinesO[i], planes[i]);
      }

      dt_ = dt;

      return plinesPlanar;



    }

    // <Custom additional code>


    public static  Polyline IntersectLines(Line[] lines, Line[] linesO, Plane plane) {

      Polyline pline = new Polyline(lines.Length + 1);

      for (int i = 0; i < lines.Length; i++) {
        Line l0 = lines[i];
        Line l1 = lines[(i + 1) % lines.Length];
        //Line l1 = linesO[i];

        if (l0.Direction.IsParallelTo(l1.Direction, 0.1) != 0) {
          l1 = linesO[i];
        }

        if (l0.Direction.IsParallelTo(l1.Direction, 0.1) != 0 && false) {

          Plane plane_ = new Plane(plane);
          plane_.Origin = l0.PointAt(0.5);

          //Print("Colinear");

          //continue;
          Line lMid0 = new Line(l0.From, l0.To);
          lMid0 = lMid0.Rotate(90, plane_);

          Line lMid1 = new Line(l1.From, l1.To);
          lMid1 = lMid1.Rotate(90, plane_);

          Line lMid = new Line((lMid0.From + lMid1.From) * 0.5, (lMid0.To + lMid1.To) * 0.5);
          lMid = lMid1;


          Point3d pMid = NGonsCore.LineUtil.LineLine(l0, lMid);
          pline.Add(pMid);

          pMid = NGonsCore.LineUtil.LineLine(lMid, l1);
          pline.Add(pMid);

          //Rhino.RhinoDoc.ActiveDoc.Objects.AddLine(l0);
          // Rhino.RhinoDoc.ActiveDoc.Objects.AddLine(lMid);
        } else {

          Point3d p = NGonsCore.LineUtil.LineLine(l0, l1);
          pline.Add(p);
        }

      }

      pline.Close();

      return pline;

    }

  }
# ---------- end c_script ----------
fromp_2 = FromPolylines(Curves=flatten(c_script.plines), Min_Triangulation=True)
crv = Curve(<curve referenced from the Rhino model>)
weld = WeldMesh(Mesh=fromp_2, Radius=0.1, Align=True, Use_RTree=True)
pln = Plane(crv)
c_script_2 = CSharpScript(
    mesh=weld,
    flat_plane=pln,
    Reference="C:\Users\petrasv\AppData\Roaming\McNeel\Rhinoceros\packages\7.0\NGon\3.2.0\NGonsCore.dll")  # -> out, graft(bot_plines), graft(top_plines); inputs mesh: Mesh, flat_plane: Plane
# ---------- c_script_2: C# usings ----------
using NGonsCore;
using System.Linq;
# ---------- c_script_2: C# ----------
    // get planes
    Plane[] face_planes = mesh._FPlanes();

    Plane[][] edge_planes = null;
        GetEdgePlanes(mesh,  out edge_planes);
    

    
    // create outlines by plante to plane intersections

    var bot_plines = new List<Polyline>();
    var top_plines = new List<Polyline>();

    for(int i = 0; i < mesh.Ngons.Count; i++){
      Polyline bot_polyline = NGonsCore.PolylineUtil.PolylineFromPlanes(face_planes[i], edge_planes[i].ToList(), true);
      Polyline top_polyline = NGonsCore.PolylineUtil.PolylineFromPlanes(flat_plane, edge_planes[i].ToList(), true);
      bot_plines.Add(bot_polyline);
      top_plines.Add(top_polyline);
    }
    
    //output
    _bot_plines = bot_plines;
    _top_plines = top_plines;
# ---------- c_script_2: C# additional code ----------
  public void GetEdgePlanes( Mesh M, out Plane[][] edgePlanes) {

    int[][] fv = M.GetNGonsTopoBoundaries();

    edgePlanes = new Plane[fv.Length][];

            

    for (int i = 0; i < fv.Length; i++) {

      int n = fv[i].Length;

      edgePlanes[i] = new Plane[n];



      for (int j = 0; j < fv[i].Length; j++) {

        int v0 = fv[i][MathUtil.Wrap(j - 1, n)];
        int v1 = fv[i][(j + 0) % n];
        int v2 = fv[i][(j + 1) % n];

        int e = M.TopologyEdges.GetEdgeIndex(v0, v1);
        int[] cf = M.TopologyEdges.GetConnectedFaces(e);
        Vector3d sum = Vector3d.Zero;

        for(int k = 0;k < cf.Length; k++) {
          sum += M.FaceNormals[cf[k]];
        }
        sum /= cf.Length;

       if (cf.Length == 1)
            sum = Vector3d.ZAxis;




        Plane edgePlane = new Plane((Point3d) (M.Vertices[v0] + M.Vertices[v1]) * 0.5, M.Vertices[v0] - M.Vertices[v1], sum);//M.Normals[v0] + M.Normals[v1]



 
        edgePlanes[i][j] = edgePlane;

      }//for j
    }//for i

    //BisePlanes = bisePlanes;
    //EdgePlanes = edgePlanes;

  }
# ---------- end c_script_2 ----------
loft_m = Loft_mesh(p0=c_script_2.bot_plines, p1=c_script_2.top_plines)  # -> mesh; inputs p0: list of Curve, p1: list of Curve
#   port p0: polylines with holes, bottom
#   port p1: polylines with holes, top
#   port mesh: lofted and capped mesh with holes
# ---------- loft_m: Python ----------
"""get joints ids and connections areas between elements"""

__author__ = "petras vestartas"
__version__ = "2023.03.31"

from ghpythonlib.componentbase import executingcomponent as component
import Rhino.RhinoDoc
import Rhino.Geometry
import System
from System.Drawing import Color

class connections_zones(component):


    def to_polyline_from_cp(self, curve):
        
        polyline = Rhino.Geometry.Polyline() 
        result, polyline1 = curve.TryGetPolyline()
        
        if (result == False):
            
            nurbsCurve = curve.ToNurbsCurve()  
            point3dArray = []
            
            for i in range(nurbsCurve.Points.Count):
                result, pt = nurbsCurve.Points.GetPoint(i)
                point3dArray.append(pt)
            
            polyline1 = Rhino.Geometry.Polyline(point3dArray)  
            nurbsCurve = polyline1.ToNurbsCurve()  
            result, polyline1 = nurbsCurve.TryGetPolyline()  
            
            polyline1.CollapseShortSegments(0.01) 
            
            polyline1 = Rhino.Geometry.Polyline(polyline1)  
            polyline = polyline1  
            
        else:
            polyline1.CollapseShortSegments(0.01)  
            polyline = polyline1  
        
        return polyline  

    def loft_polylines_with_holes(self, curves0, curves1):
        """Loft polylines with holes
        
        Parameters
        ----------
        curves0 : list[rg.Polyline]
        curves1 : list[rg.Polyline]
        
        Returns
        -------
        rg.Mesh
            mesh as lofted polylines and cap them
        """
        
        ###############################################################################
        # user input
        ###############################################################################
        
        flag = len(curves0) is not 0 if True else len(curves1) != 0
        if (flag):
            
            curves = []
            curves2 = []
            
            flag0 = len(curves1) == 0
            flag1 = len(curves0) == 0 and len(curves1) != 0
            flag2 = len(curves0) and len(curves1)
            
            if (flag0):
                for i in range(len(curves0)):
                    if (float(i) >= float(len(curves0)) * 0.5):
                        curves2.Add(curves0[i])
                    else:
                        curves.Add(curves0[i])
            elif (flag1):
                for i in range(0, len(curves1), 2):
                    curves.Add(curves1[i])
                    curves2.Add(curves1[i + 1])
            elif (flag2):
                curves = curves0
                curves2 = curves1
            
            curves0 = curves
            curves1 = curves2
        
        ###############################################################################
        # sort curves which one is border and which ones are holes
        ###############################################################################
        length = -1.0
        border_id = -1
        count = 0
        numArray = []
        for curve in curves0:
            diagonal = curve.GetBoundingBox(True).Diagonal
            temp_length = diagonal.Length
            if temp_length > length:
                length = temp_length
                border_id = count
            count=count+1
        
        
        border0 = self.to_polyline_from_cp(curves0[border_id])
        border1 = self.to_polyline_from_cp(curves1[border_id])
        holes0 = []
        holes1 = []
        for i in range(curves0.Count):
            if (i != border_id):
                holes0.Add(curves0[i])
                holes1.Add(curves1[i])
        
        ###############################################################################
        # Create mesh of the bottom face
        ###############################################################################
        mesh_bottom = Rhino.Geometry.Mesh.CreatePatch(border0, Rhino.RhinoDoc.ActiveDoc.ModelAngleToleranceRadians, None, holes0, None, None, True, 1)
        
        ###############################################################################
        # Convert closed polylines to open ones
        ###############################################################################
        
        point_3d_array = []
        for i in range(len(mesh_bottom.Vertices)):
            point_3d_array.append(mesh_bottom.Vertices.Point3dAt(i))
        
        open_curve_points_0 = []
        open_curve_points_1 = []
        
        for i in range(border0.Count-1):
            open_curve_points_0.append( border0[i])
            open_curve_points_1.append( border1[i])
        
        for i in range(holes0.Count):
            holes0_polyline = self.to_polyline_from_cp(holes0[i]) 
            holes1_polyline = self.to_polyline_from_cp(holes1[i]) 
            for j in range(len(holes0_polyline)-1):
                open_curve_points_0.append(holes0_polyline[j])
                open_curve_points_1.append(holes1_polyline[j])
        
        ###############################################################################
        # Using the bottom mesh vertices create the top mesh f
        ###############################################################################
        points_to_sort_new = self.sort_set_of_points(open_curve_points_0, point_3d_array)
        mesh_top = mesh_bottom.DuplicateMesh()
        
        for i in range(len(points_to_sort_new)):
            mesh_top.Vertices.SetVertex(i, open_curve_points_1[points_to_sort_new[i]])
        
        ###############################################################################
        # Merge the top and bottom mesh into one and add sides
        ###############################################################################
        mesh = Rhino.Geometry.Mesh()
        mesh.Append(mesh_bottom)
        mesh.Append(mesh_top)
        
        count = mesh_bottom.Vertices.Count
        for p in range (mesh_bottom.TopologyEdges.Count):
            
            if (mesh_bottom.TopologyEdges.GetConnectedFaces(p).Length == 1):
                topologyVertices = mesh_bottom.TopologyEdges.GetTopologyVertices(p)
                mesh.Faces.AddFace(topologyVertices.I, topologyVertices.J, topologyVertices.J + count, topologyVertices.I + count)
        
        mesh.UnifyNormals()
        mesh.Ngons.AddPlanarNgons(Rhino.RhinoDoc.ActiveDoc.ModelAbsoluteTolerance * 1, 3, 1, True)
        
        ###############################################################################
        # Unweld ngons meshes
        ###############################################################################
        unwelded_ngon_mesh = Rhino.Geometry.Mesh()
        count = 0
        for ngonAndFacesEnumerable in mesh.GetNgonAndFacesEnumerable():
            
            faces = []
            for j in ngonAndFacesEnumerable.FaceIndexList():
                faces.append(System.Int32(j))
            
            temp_ngon_mesh = mesh.DuplicateMesh().Faces.ExtractFaces(faces)
            
            #add colors
            if(count<2):
                temp_ngon_mesh.VertexColors.CreateMonotoneMesh(Color.LightGray)
            else:
                temp_ngon_mesh.VertexColors.CreateMonotoneMesh(Color.DeepPink)

            unwelded_ngon_mesh.Append(temp_ngon_mesh)
            count = count + 1
        
        ###############################################################################
        # Output
        ###############################################################################
        unwelded_ngon_mesh.RebuildNormals()
        return unwelded_ngon_mesh




    def sort_set_of_points(self, points_to_sort, guide_points):
        """Sort one array of point by an another point array
        
        use it like this: 
        #points_to_sort_new = []
        #for i in points_to_sort_ids:
        #    points_to_sort_new.append(points_to_sort[i])
        
        Parameters
        ----------
        points_to_sort : list[rg.Point3d]
        guide_points : list[rg.Point3d]
        
        Returns
        -------
        list[int]
            the list of indices of the sorted array
        """
        
        # create a copy
        points_to_sort_copy = []
        for i in points_to_sort:
            points_to_sort_copy.append(Rhino.Geometry.Point3d(i))
        
        guide_points_copy = []
        for i in guide_points:
            guide_points_copy.append(Rhino.Geometry.Point3d(i))
        
        # make indices of points
        points_to_sort_ids = list(range(0,len(points_to_sort_copy)))
        guide_points_ids = list(range(0,len(guide_points_copy)))
        
        # sort both lists by xyz coordinates together with indices
        points_to_sort_copy, points_to_sort_ids = zip(*sorted(zip(points_to_sort_copy, points_to_sort_ids)))
        guide_points_copy, guide_points_ids = zip(*sorted(zip(guide_points_copy, guide_points_ids)))
        
        # sort guide points indices and order the points to sort indec
        guide_points_ids, points_to_sort_ids = zip(*sorted(zip(guide_points_ids, points_to_sort_ids)))
        
        # can be used like this:
        #points_to_sort_new = []
        #for i in points_to_sort_ids:
        #    points_to_sort_new.append(points_to_sort[i])
        
        return points_to_sort_ids

    def RunScript(self, _p0, _p1):
        if _p0 and _p1:
            return self.loft_polylines_with_holes(_p0, _p1)
# ---------- end loft_m ----------
crv_2 = Curve(Tree({0;0;0;0}: [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], {0;0;0;1}: [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], {0;0;0;2}: [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], {0;0;0;3}: [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], {0;0;0;4}: [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], {0;0;0;5}: [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]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))
crv_3 = Curve(Tree({0;0;0;0}: [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], {0;0;0;1}: [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], {0;0;0;2}: [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], {0;0;0;3}: [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], {0;0;0;4}: [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], {0;0;0;5}: [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]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))
loft = Loft(
    Curves=[c_script_2.bot_plines, c_script_2.top_plines],
    Options={Adjust=False, Closed=False, LoftEnds=0, LoftSimp=0, LoftType=0, Rebuild=10, Refit=0.01})
cap = CapHoles(Brep=loft)
from_brep = FromBrep(Brep=cap, Weld=-1)  # -> Mesh, Polylines
explodemesh = ExplodeMesh(Mesh=from_brep.Mesh, Explode=False)
crv_4 = Curve(Tree({0;0;0;0}: [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], {0;0;0;1}: [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], {0;0;0;2}: [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], {0;0;0;3}: [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], {0;0;0;4}: [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], {0;0;0;5}: [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], {0;0;0;6}: [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], {0;0;0;7}: [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], {0;0;0;8}: [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]))
crv_5 = Curve(Tree({0;0;0;0}: [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], {0;0;0;1}: [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], {0;0;0;2}: [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], {0;0;0;3}: [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], {0;0;0;4}: [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], {0;0;0;5}: [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], {0;0;0;6}: [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], {0;0;0;7}: [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], {0;0;0;8}: [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]))
ngonpreview = NGonPreview(Mesh=explodemesh, LineColor=RGB(0, 0, 0))
